# Grasshopper definition Assignment01-Metball-Hops.gh (Grasshopper 1.0.7)
# plug-ins: Human

size_x = Slider(10, range=1..20)
size_y = Slider(10, range=1..20)
accuracy = Slider(0.6, range=0..5)
size_x_2 = GetInteger(size_x, AtLeast=1, AtMost=1, Maximum=2147483647, Minimum=-2147483648, Prompt="1-20", TreeAccess=False)
size_y_2 = GetInteger(size_y, AtLeast=1, AtMost=1, Maximum=2147483647, Minimum=-2147483648, Prompt="1-20", TreeAccess=False)
accuracy_2 = GetNumber(
    accuracy,
    AtLeast=1,
    AtMost=1,
    Maximum=1.797693135e+308,
    Minimum=-1.797693135e+308,
    Prompt="Accuracy 0.0-5.0",
    TreeAccess=False)
domain_box = DomainBox(Base=PlaneXY(0, 0, 0), X=size_x_2, Y=size_y_2, Z=Slider(1, range=0..1))
multiplication = Multiplication(A=size_x_2, B=size_y_2)
populate_3d = Populate3D(Region=domain_box, Count=multiplication, Seed=Slider(120, range=0..1000))
metaball = MetaBall(Points=populate_3d, Plane=PlaneXY(0, 0, 0), Point=populate_3d, Accuracy=accuracy_2)
curve = Curve(metaball)
custom_preview_lineweights = CustomPreviewLineweights(Geometry=curve, Shader=ColourSwatch(SwatchColor=RGB(77, 61, 255)), Absolute=False)
context_bake = ContextBake(Geometry=curve)
